# Grasshopper definition Offset Mesh.gh (Grasshopper 1.0.7)
# plug-ins: Weaverbird, Anemone, Kangaroo2 Components, Pufferfish, MeshEdit Components, MetaHopper, EleFront

# ----
# Offset Mesh
# Structural Analysis Mesh
# Refer to the mesh from the structural analysis and remap the colors.
# In this tutorial a fragment of the geometry is offset in relation to the utilization values required from the structural analysis. The result is a solid mesh which will contain the voronoi structure.
pipeline = GeometryPipeline(
    GroupByLayer=False,
    GroupByType=False,
    IncludeHidden=True,
    IncludeLocked=True,
    LayerFilter="Fragment::Utilization",
    NameFilter="*",
    SublayerFiltering=True,
    TypeFilter=32)
wbloop = WeaverbirdsLoopSubdivision(MeshCurves=pipeline, Level=1, SmoothNakedEdges=1)
demesh = DeconstructMesh(Mesh=wbloop)  # -> Vertices, Faces, Colours, Normals
ahsv = SplitAHSV(Colour=demesh.Colours)  # -> Alpha, Hue, Saturation, Value
bnd = Bounds(Numbers=ahsv.Saturation)
remap = RemapNumbers(Value=ahsv.Saturation, Source=bnd, Target=Domain(0, 1))  # -> Mapped, Clipped
graph = GraphMapper(remap.Clipped, x0=0, x1=1, y0=0, y1=1, container_name="Bezier", cpx=[0, 0.295909524, 0, 1], cpy=[0, 0.4068180323, 1, 1])
hsv = ColourHSV(Alpha=1, Hue=ahsv.Hue, Saturation=graph, Value=ahsv.Value)
conmesh = ConstructMesh(Vertices=demesh.Vertices, Faces=demesh.Faces, Colours=hsv)

# ----
# Mesh
# Refer to the geometry of the fragment. A part of the surroundings is included, because this will affect the voronoi structure within the fragment.
pipeline_2 = GeometryPipeline(
    GroupByLayer=False,
    GroupByType=False,
    IncludeHidden=True,
    IncludeLocked=True,
    LayerFilter="Fragment::Surroundings",
    NameFilter="*",
    SublayerFiltering=True,
    TypeFilter=32)
flip = MeshFlip(Mesh=pipeline_2)
unim = UnifyMesh(Mesh=flip)  # -> Result, Count

# ----
# Visualize
visualize_color_mesh = BooleanToggle(False)
sort = SortList(Keys=graph)  # -> Keys, ValuesA
graph_2 = QuickGraph(sort.Keys, SortOrder=0)
onoff = EnableDisableObject(Enabled=visualize_color_mesh, AllObjects_Object=preview)
preview = CustomPreview(
    Geometry=conmesh,
    Material={diffuse=RGB(221, 160, 221), emission=RGB(66, 48, 66), shine=0.5, specular=RGB(255, 255, 255), transparency=0})  # disabled

# ---- group: Offset Properties
maximum_thickness = Slider(1200, range=0..1200)
minimum_thickness = Slider(300, range=0..400)
speed = Slider(4, range=0..4)

# ----
# Offset Vectors
demesh_2 = DeconstructMesh(Mesh=unim.Result)  # -> Vertices, Faces, Colours, Normals
meshcp = MeshClosestPoint(Point=demesh_2.Vertices, Mesh=conmesh)  # -> Point, Index, Parameter
meval = MeshEval(Mesh=conmesh, Parameter=meshcp.Parameter)  # -> Point, Normal, Colour
division = Division(A=minimum_thickness, B=speed)
ahsv_2 = SplitAHSV(Colour=meval.Colour)  # -> Alpha, Hue, Saturation, Value
division_2 = Division(A=maximum_thickness, B=division)
bnd_2 = Bounds(Numbers=ahsv_2.Saturation)
dom = ConstructDomain(DomainStart=speed, DomainEnd=division_2)
remap_2 = RemapNumbers(Value=ahsv_2.Saturation, Source=bnd_2, Target=dom)  # -> Mapped, Clipped

# ----
# Outer Vertices
nv = NakedVertices(Mesh=unim.Result)  # -> ClothedIndex, NakedIndex, ClothedPts, NakedPts
cp = ClosestPoint(Point=demesh_2.Vertices, Cloud=nv.NakedPts)  # -> ClosestPoint, CPIndex, Distance
smaller = SmallerThan(FirstNumber=cp.Distance, SecondNumber=0.05)  # -> SmallerThan, OrEqualTo
not = GateNot(A=smaller.SmallerThan)

# ----
# Offset Data
# Calculate as much data as possible outside the loop for efficiency reasons. For the smoothening the indices of the neighbouring vertices and naked vertices are required. For the offsetting the vectors can be calculated from the saturation data of the colored utilization mesh.
# Neighbours
lng = ListLength(List=demesh_2.Vertices)
series = Series(Start=0, Step=1, Count=lng)
vn = VertexNeighbours(Mesh=unim.Result, VertexNumber=series)  # -> Vertex, Neighbours, Normal
fsim = FindSimilarMember(Data=vn.Neighbours, Set=demesh_2.Vertices)  # -> Hit, Index

# ----
# Offset
amp = Amplitude(Vector=demesh_2.Normals, Amplitude=remap_2.Clipped)

# ---- group: Bake
button = Button()

# ----
# Offset Mesh
# Every vertex is move with a vector derived from the structural analysis. To keep the mesh uniform and prevent self-intersections the mesh is smoothened by adding a vector towards its neighbours. This vector is partially projected parallel to the mesh. Naked vertices are excluded from this to prevent the mesh from shrinking.
button_2 = Button()
loop_start = LoopStart(Repeat=division, Trigger=button_2, Data=unim.Result)  # -> port, Counter, Data
panel = Panel(loop_start.Counter)

# ---- group: Smoothening Vector
demesh_3 = DeconstructMesh(Mesh=loop_start.Data)  # -> Vertices, Faces, Colours, Normals
item = ListItem(List=demesh_3.Vertices, Index=fsim.Index, Wrap=True)
vec2pt = Vector2Pt(PointA=graft(demesh_3.Vertices), PointB=item, Unitize=False)  # -> Vector, Length
ma = MassAddition(Input=vec2pt.Vector)  # -> Result, PartialResults
lng_2 = ListLength(List=vec2pt.Vector)
division_3 = Division(A=ma.Result, B=lng_2)  # -> flatten(Result)

# ---- group: Project Parallel
pl = PlaneNormal(Origin=Point(0, 0, 0), ZAxis=demesh_3.Normals)
project = Project(Geometry=division_3, Plane=pl)  # -> Geometry, Transform

# ----
# Smoothening
twn2vecs = TweenTwoVectors(VectorA=division_3, VectorB=project.Geometry, Factor=0.5)

# ---- group: Exclude Naked
multiplication = Multiplication(A=twn2vecs, B=not)

# ----
# Move
number_slider = Slider(0.8, range=0..1)
twn2vecs_2 = TweenTwoVectors(VectorA=multiplication, VectorB=amp, Factor=number_slider)
move = Move(Geometry=demesh_3.Vertices, Motion=twn2vecs_2)  # -> Geometry, Transform
conmesh_2 = ConstructMesh(Vertices=move.Geometry, Faces=demesh_3.Faces)

loop_end = LoopEnd(port=loop_start.port, Exit=False, Data=conmesh_2, TimeOutVal=0, pausedState=False, state="Output last")

# ----
# Solid Mesh
# Meshes are created between the naked edges of both the original mesh and the offset mesh. All meshes are joined and welded to create a single solid mesh.
wbcatmullclark = WeaverbirdsCatmullClarkSubdivision(MeshCurves=unim.Result, Level=1, SmoothNakedEdges=0)
wbcatmullclark_2 = WeaverbirdsCatmullClarkSubdivision(MeshCurves=loop_end, Level=1, SmoothNakedEdges=0)
medges = MeshEdges(Mesh=wbcatmullclark)  # -> NakedEdges, InteriorEdges, NonManifoldEdges
medges_2 = MeshEdges(Mesh=wbcatmullclark_2)  # -> NakedEdges, InteriorEdges, NonManifoldEdges
rulesrf = RuledSurface(CurveA=medges.NakedEdges, CurveB=medges_2.NakedEdges)
smesh = SimpleMesh(Brep=rulesrf)
merge = Merge(Data1=wbcatmullclark, Data2=smesh, Data3=wbcatmullclark_2)
wbjoin = WeaverbirdsJoinMeshesAndWeld(Mesh=flatten(merge), Weld=True)
unim_2 = UnifyMesh(Mesh=wbjoin)  # -> Result, Count

# ----
# Bake
# Bake the geometry to a specific layer. Use the layer name attribute to define the layer and use this in the geometry pipeline in a succeeding script. Use the bakename to replace any geometry previously bake with that name.
panel_2 = Panel("Fragment::Volume::Surroundings")
attributes = DefineObjectAttributes(Layer=panel_2)
bake = BakeObjects(Geometry=unim_2.Result, Attributes=attributes, BakeName="Volume Surroundings", Bake=button)
