# Grasshopper definition Structural Analysis Field.gh (Grasshopper 1.0.7)
# plug-ins: Anemone, LunchBoxML, Pufferfish, NudiBranch, MeshEdit Components, Parakeet, MetaHopper, Human, EleFront, Weaverbird

# ----
# Refer to Geometry
# Structural Analysis Field
# In this grasshopper tutorial, geometry in Rhino will be structurally analysed using Karamba. The output will be a mesh containing utilization information as color data. The aim is to use this data to inform the density of a point cloud, which in turn will be used to generate a voronoi structure.
# Notice that the Rhino unit settings are in meters. This is because Karamba uses meters in its calculations. When copying geometry from a file in millimeters to a file in meters is is properly scaled automatically, when changing the unit settings it needs to be scaled accordingly.
pipeline = GeometryPipeline(
    GroupByLayer=False,
    GroupByType=False,
    IncludeHidden=True,
    IncludeLocked=True,
    LayerFilter="Fragment::Utilization",
    NameFilter="*",
    SublayerFiltering=True,
    TypeFilter=32)
pipeline_2 = GeometryPipeline(
    GroupByLayer=False,
    GroupByType=False,
    IncludeHidden=True,
    IncludeLocked=True,
    LayerFilter="Fragment::Volume::Surroundings_Reduced",
    NameFilter="*",
    SublayerFiltering=True,
    TypeFilter=32)

# ----
# Remap Values
wbloop = WeaverbirdsLoopSubdivision(MeshCurves=pipeline, Level=1, SmoothNakedEdges=1)
demesh = DeconstructMesh(Mesh=wbloop)  # -> Vertices, Faces, Colours, Normals
ahsv = SplitAHSV(Colour=demesh.Colours)  # -> Alpha, Hue, Saturation, Value
bnd = Bounds(Numbers=ahsv.Saturation)
remap = RemapNumbers(Value=ahsv.Saturation, Source=bnd, Target=Domain(0, 1))  # -> Mapped, Clipped
graph = GraphMapper(
    remap.Clipped,
    x0=0,
    x1=1,
    y0=0,
    y1=1,
    container_name="Bezier",
    cpx=[0, 0.2649397552, 1, 1],
    cpy=[0, 0.713180542, 0.6728432178, 1])
hsv = ColourHSV(Alpha=1, Hue=ahsv.Hue, Saturation=graph, Value=1)
conmesh = ConstructMesh(Vertices=demesh.Vertices, Faces=demesh.Faces, Colours=hsv)
mesh = Mesh(conmesh)
mblur = BlurMesh(Mesh=mesh, Iterations=Slider(1, range=0..10))

# ----
# Plane
demesh_2 = DeconstructMesh(Mesh=pipeline_2)  # -> Vertices, Faces, Colours, Normals
fline = FitLine(Points=demesh_2.Vertices)
xy = XYPlane(Origin=Point(0, 0, 0))
eval = EvaluateCurve(Curve=reparameterize(fline), Parameter=0.5)  # -> Point, Tangent, Angle
X = UnitX(Factor=1)
angle = Angle(VectorA=X, VectorB=eval.Tangent, Plane=xy)  # -> Angle, Reflex
prot = RotatePlane(Plane=xy, Angle=angle.Angle)

visualize_color_mesh = BooleanToggle(False)
onoff = EnableDisableObject(Enabled=visualize_color_mesh, AllObjects_Object=preview)
preview = CustomPreview(
    Geometry=conmesh,
    Material={diffuse=RGB(221, 160, 221), emission=RGB(66, 48, 66), shine=0.5, specular=RGB(255, 255, 255), transparency=0})  # disabled

# ---- group: Loop Properties
duration = Slider(200, range=0..300)
distancing = Slider(0.15, range=0..1)
speed = Slider(60, range=0..100)

# ---- group: Bake
button = Button()

# ----
# Orthogonal Grid
number_slider = Slider(150, range=0..600)
bbox = BoundingBox(Content=pipeline_2, Plane=prot, UnionBox=True)  # -> Box, Box_2

brepoffset = OffsetBrep(Brep=bbox.Box, Distance=expr("x*2", number_slider), Solid=False, BothSides=False, RoundCorners=True, MergeFaces=False)
bbox_2 = BoundingBox(Content=brepoffset, Plane=prot, UnionBox=True)  # -> Box, Box_2

debox = DeconstructBox(Box=bbox_2.Box)  # -> Plane, X, Y, Z
dedomain = DeconstructDomain(Domain=debox.X)  # -> Start, End
dedomain_2 = DeconstructDomain(Domain=debox.Y)  # -> Start, End
dedomain_3 = DeconstructDomain(Domain=debox.Z)  # -> Start, End
subtraction = Subtraction(A=dedomain.End, B=dedomain.Start)
subtraction_2 = Subtraction(A=dedomain_2.End, B=dedomain_2.Start)
subtraction_3 = Subtraction(A=dedomain_3.End, B=dedomain_3.Start)
abs = Absolute(Value=subtraction)
abs_2 = Absolute(Value=subtraction_2)
abs_3 = Absolute(Value=subtraction_3)
division = Division(A=abs, B=number_slider)
division_2 = Division(A=abs_2, B=number_slider)
division_3 = Division(A=abs_3, B=number_slider)
boxgrid = Box3dGrid(Boundary=bbox_2.Box, CountX=division, CountY=division_2, CountZ=division_3)  # -> flatten(PointGrid)

# ----
# Populate Geometry
# The geometry is populated with points here. The average density can be expressed in points per liter. The density will be increased later with the addition of other informed point clouds.
# Because the 'Populate 3D' component can demand a lot of computation time, it is used for a fraction of the intended amount of points and then moved with an array of vectors.
mesh_2 = Mesh(pipeline_2)
vecworld = VectorWorld(Plane=PlaneXY(0, 0, 0), WorldType=2, Dimensionality=False)  # -> Vectors, Lines
bbox_3 = BoundingBox(Content=mesh_2, Plane=prot, UnionBox=True)  # -> Box, Box_2
lng = ListLength(List=vecworld.Vectors)
division_4 = Division(A=Slider(0.5, range=0..1), B=lng)
amp = Amplitude(Vector=vecworld.Vectors, Amplitude=Slider(200, range=0..200))  # -> graft(Vector)

# ---- group: Density / Liter
volume = MeshVolume(Mesh=bbox_3.Box)  # -> expr("x/1000000", Volume), Centroid

# ---- group: Density
multiplication = Multiplication(A=division_4, B=volume.Volume)

# ----
# Point Values
meshcp = MeshClosestPoint(Point=boxgrid, Mesh=mblur)  # -> Point, Index, Parameter
meval = MeshEval(Mesh=mblur, Parameter=meshcp.Parameter)  # -> Point, Normal, Colour
nullrep = ReplaceNulls(Items=meval.Colour, Replacements=ColourSwatch(SwatchColor=RGB(255, 255, 255)))  # -> Items, Count
ahsv_2 = SplitAHSV(Colour=nullrep.Items)  # -> Alpha, Hue, Saturation, Value
bnd_2 = Bounds(Numbers=ahsv_2.Saturation)
remap_2 = RemapNumbers(Value=ahsv_2.Saturation, Source=bnd_2, Target=Domain(0, 1))  # -> Mapped, Clipped
smoothen = Slider(1, range=0..1)
graph_2 = GraphMapper(
    remap_2.Clipped,
    x0=0,
    x1=1,
    y0=0,
    y1=1,
    container_name="Bezier",
    cpx=[0, 0, 0.6873016357, 1],
    cpy=[0, 0.6542531848, 0.8973644972, 1])

pop3d = Populate3D(Region=bbox_3.Box, Count=multiplication, Seed=1)

move = Move(Geometry=pop3d, Motion=amp)  # -> flatten(Geometry), Transform

minc = MeshInclusion(Mesh=mesh_2, Point=move.Geometry, Strict=False)
cull = CullPattern(List=move.Geometry, CullPattern=minc)  # -> flatten(List)
lng_2 = ListLength(List=cull)
amount = Panel(lng_2)

# ----
# Point Vectors
prox = Proximity3D(Points=boxgrid, Group=6, MaxRadius=expr("x*1.1", number_slider))  # -> Links, Topology
rtree = CreateRTree(InputGeometry=boxgrid)
item = ListItem(List=boxgrid, Index=prox.Topology, Wrap=True)
rtree_cp = RTreeClosestPoint(SearchPoints=item, RTree=rtree)  # -> ClosestPoint, ClosestIndex
vec2pt = Vector2Pt(PointA=graft(boxgrid), PointB=item, Unitize=False)  # -> Vector, Length

item_2 = ListItem(List=graph_2, Index=prox.Topology, Wrap=True)
avr = Average(Input=item_2)  # -> flatten(ArithmeticMean)
twn2nums = TweenTwoNumbers(NumberA=graph_2, NumberB=avr, Factor=smoothen)

item_3 = ListItem(List=twn2nums, Index=rtree_cp.ClosestIndex, Wrap=True)
amp_2 = Amplitude(Vector=vec2pt.Vector, Amplitude=item_3)
avr_2 = Average(Input=amp_2)  # -> flatten(ArithmeticMean)

# ----
# Field Preview
minc_2 = MeshInclusion(Mesh=pipeline_2, Point=boxgrid, Strict=False)
hsv_2 = ColourHSV(Alpha=1, Hue=0, Saturation=twn2nums, Value=1)
visualize_vectors = BooleanToggle(False)
visualize_points = BooleanToggle(False)
cull_2 = CullPattern(List=hsv_2, CullPattern=minc_2)
cull_3 = CullPattern(List=boxgrid, CullPattern=minc_2)
onoff_2 = EnableDisableObject(Enabled=visualize_vectors, AllObjects_Object=[vdisex, sort, item_4, division_5, multiplication_4, cull_4])
or = GateOr(A=visualize_vectors, B=visualize_points)
onoff_3 = EnableDisableObject(Enabled=visualize_points, AllObjects_Object=cloud)
onoff_4 = EnableDisableObject(Enabled=or)

# ----
# Remap Values
gradient_shift = Slider(0.1, range=0..0.5)
dom = ConstructDomain(DomainStart=expr("1+x", gradient_shift), DomainEnd=expr("1-x", gradient_shift))
avr_3 = Average(Input=item_3)
multiplication_2 = Multiplication(A=avr_2)
remap_3 = RemapNumbers(Value=avr_3, Source=Domain(0, 1), Target=dom)  # -> Mapped, Clipped
vlen = VectorLength(Vector=multiplication_2)
multiplication_3 = Multiplication(A=vlen, B=flatten(remap_3.Clipped))
bnd_3 = Bounds(Numbers=multiplication_3)
dom_2 = ConstructDomain(DomainStart=0, DomainEnd=speed)
remap_4 = RemapNumbers(Value=multiplication_3, Source=bnd_3, Target=dom_2)  # -> Mapped, flatten(Clipped)

# ---- group: Points
hideshow = HideShowObjectPreview(Visible=visualize_points, AllObjects_Object=cloud)
cloud = CloudDisplay(Points=cull_3, Colours=cull_2, Size=Slider(15, range=0..100), SpriteType=1)  # disabled

# ----
# Vector Field
# An orthogonal grid is generated in the geometry and the utilization data is extrapolated. Then for each point the values of the neighbours are compared and a vector is generated accordingly. The result is a vector field attracted towards the areas with higher utilization values.
amp_3 = Amplitude(Vector=avr_2, Amplitude=remap_4.Clipped)

# ---- group: Vectors
sort = SortList(Keys=amp_3)  # -> reverse(Keys), ValuesA; disabled
item_4 = ListItem(List=sort.Keys, Index=0, Wrap=True)  # disabled
division_5 = Division(A=number_slider, B=item_4)  # disabled
multiplication_4 = Multiplication(A=division_5, B=amp_3)  # disabled
cull_4 = CullPattern(List=multiplication_4, CullPattern=minc_2)  # disabled
vdisex = VectorDisplayEx(Point=cull_3, Vector=expr("x*5", cull_4), Colour=cull_2, Width=3)  # disabled

# ----
# Transform Point Cloud
# The point cloud is transformed according to the values of the vector field. In each iteration the closest point in the field is searched for and the related vector is selected. This is combined with a distancing vector to ensure a minimum voronoi cell size later.
# The distribution of the points in the point cloud determine the sizes of the voronoi cells later. This can be controlled by remapping the color data in the structural analysis mesh (at the beginning of this script), remapping the values in the vector field and the loop properties.
button_2 = Button()
loop_start = LoopStart(N=duration, T=button_2, D0=cull)  # -> port, Counter, Data, Data_2
panel = Panel(loop_start.Counter)

# ---- group: Distance
minimum_radius = Slider(50, range=0..100)
maximum_radius = Slider(80, range=0..100)
prox_2 = Proximity3D(Points=loop_start.Data, Group=5, MaxRadius=maximum_radius)  # -> Links, Topology
item_5 = ListItem(List=loop_start.Data, Index=prox_2.Topology, Wrap=True)
vec2pt_2 = Vector2Pt(PointA=item_5, PointB=graft(loop_start.Data), Unitize=False)  # -> Vector, Length
dom_3 = ConstructDomain(DomainStart=minimum_radius, DomainEnd=maximum_radius)
remap_5 = RemapNumbers(Value=vec2pt_2.Length, Source=dom_3, Target=Domain(1, 0))  # -> Mapped, Clipped
graph_3 = GraphMapper(
    remap_5.Clipped,
    x0=0,
    x1=1,
    y0=0,
    y1=1,
    container_name="Bezier",
    cpx=[0, 0.5445445776, 0.7432140112, 1],
    cpy=[0, 0, 1, 1])
amp_4 = Amplitude(Vector=vec2pt_2.Vector, Amplitude=graph_3)
avr_4 = Average(Input=amp_4)
vlen_2 = VectorLength(Vector=avr_4)
dom_4 = ConstructDomain(DomainStart=speed, DomainEnd=0)
remap_6 = RemapNumbers(Value=vlen_2, Source=Domain(0, 1), Target=dom_4)  # -> Mapped, Clipped
amp_5 = Amplitude(Vector=avr_4, Amplitude=remap_6.Clipped)
vec = VectorXYZ(XComponent=0, YComponent=0, ZComponent=0)  # -> Vector, Length
nullrep_2 = ReplaceNulls(Items=amp_5, Replacements=vec.Vector)  # -> flatten(Items), Count
division_6 = Division(A=nullrep_2.Items, B=2)

# ---- group: Field
rtree_cp_2 = RTreeClosestPoint(SearchPoints=loop_start.Data, RTree=rtree)  # -> ClosestPoint, ClosestIndex
item_6 = ListItem(List=amp_3, Index=rtree_cp_2.ClosestIndex, Wrap=True)

# ---- group: Combine and Keep Distance to Skin
mesh_3 = Mesh(pipeline_2)
meshcp_2 = MeshClosestPoint(Point=loop_start.Data, Mesh=mesh_3)  # -> Point, Index, Parameter
twn2vecs = TweenTwoVectors(VectorA=item_6, VectorB=division_6, Factor=distancing)
meval_2 = MeshEval(Mesh=mesh_3, Parameter=meshcp_2.Parameter)  # -> Point, Normal, Colour
pl = PlaneNormal(Origin=Point(0, 0, 0), ZAxis=meval_2.Normal)
project = Project(Geometry=twn2vecs, Plane=pl)  # -> Geometry, Transform

# ----
twn2vecs_2 = TweenTwoVectors(VectorA=loop_start.Data_2, VectorB=project.Geometry, Factor=0.5)
move_2 = Move(Geometry=loop_start.Data, Motion=twn2vecs_2)  # -> Geometry, Transform
loop_end = LoopEnd(
    port=loop_start.port,
    Exit=False,
    Data=move_2.Geometry,
    Data_2=twn2vecs_2,
    TimeOutVal=0,
    pausedState=False,
    state="Output last")  # -> D0, D1

# ---- group: Visualize Vectors
visualize = BooleanToggle(False)
vec_2 = Vector(item_6)  # disabled
vlen_3 = VectorLength(Vector=vec_2)  # disabled
onoff_5 = EnableDisableObject(Enabled=visualize, AllObjects_Object=[vdisex_2, hsv_3, vlen_3, bnd_4, remap_7, vec_2])
bnd_4 = Bounds(Numbers=vlen_3)  # disabled
remap_7 = RemapNumbers(Value=vlen_3, Source=bnd_4, Target=Domain(0, 1))  # -> Mapped, Clipped; disabled
hsv_3 = ColourHSV(Alpha=1, Hue=0, Saturation=remap_7.Clipped, Value=1)  # disabled
vdisex_2 = VectorDisplayEx(Point=move_2.Geometry, Vector=expr("x*30", vec_2), Colour=hsv_3, Width=3)  # disabled

# ----
clean = CleanTree(RemoveNulls=True, RemoveInvalid=True, RemoveEmpty=False, Tree=loop_end.D0)
bbox_4 = BoundingBox(Content=clean, Plane=prot, UnionBox=True)  # -> Box, Box_2

# ----
# Quick Voronoi Preview
# Very quick and dirty visualization of how the point cloud informed by structural analysis would influence the voronoi at the skin.
toggle = BooleanToggle(False)
_3dvoro = _3DVoronoi(Points=clean, Boundingbox=bbox_4.Box)  # -> _3DVoronoiCells, Connectivity; disabled
swatch = ColourSwatch(SwatchColor=RGB(255, 255, 255))  # disabled
pline2msh = PolylineToMesh(Polyline=_3dvoro._3DVoronoiCells, Quadrangulate=True)  # disabled
onoff_6 = EnableDisableObject(
    Enabled=toggle,
    AllObjects_Object=[previewlw, swatch_2, number_slider_2, _3dvoro, pline2msh, mjoin, mmx, preview_2, swatch])
preview_2 = CustomPreview(Geometry=pipeline_2, Material=swatch)  # disabled
mjoin = MeshJoin(Meshes=flatten(pline2msh))  # disabled
number_slider_2 = Slider(2.1, range=0..10)  # disabled
mmx = MeshMesh(MeshA=flatten(mjoin), MeshB=pipeline_2)  # disabled
swatch_2 = ColourSwatch(SwatchColor=RGB(0, 0, 0))  # disabled
previewlw = CustomPreviewLineweights(Geometry=mmx, Shader=swatch_2, Thickness=number_slider_2, Absolute=False)  # disabled

# ----
# Bake
# Bake the geometry to a specific layer. Use the layer name attribute to define the layer and use this in the geometry pipeline in a succeeding script. Use the bakename to replace any geometry previously bake with that name.
panel_2 = Panel("Fragment::Point Clouds::SA")
attributes = DefineObjectAttributes(Layer=panel_2)
bake = BakeObjects(Geometry=loop_end.D0, Attributes=attributes, BakeName="SA Point Cloud", Bake=button)

hideshow_2 = HideShowObjectPreview(Visible=toggle, AllObjects_Object=[previewlw, preview_2])
