# Grasshopper definition Structural Analysis.gh (Grasshopper 1.0.7)
# plug-ins: MeshEdit Components, Parakeet, EleFront, Weaverbird, MetaHopper, Kangaroo2 Components, karambaGH

# ----
# Select Geometry
# Refer to the geometry in Rhino
# Structural Analysis
# In this grasshopper tutorial, geometry in Rhino will be structurally analysed using Karamba. The output will be a mesh containing utilization information as color data. The aim is to use this data to inform the density of a point cloud, which in turn will be used to generate a voronoi structure.
# Notice that the Rhino unit settings are in meters. This is because Karamba uses meters in its calculations. When copying geometry from a file in millimeters to a file in meters is is properly scaled automatically, when changing the unit settings it needs to be scaled accordingly.
pipeline = GeometryPipeline(
    GroupByLayer=False,
    GroupByType=False,
    IncludeHidden=True,
    IncludeLocked=True,
    LayerFilter="Main Volume",
    NameFilter="*",
    SublayerFiltering=True,
    TypeFilter=32)
wbloop = WeaverbirdsLoopSubdivision(MeshCurves=pipeline, Level=1, SmoothNakedEdges=1)

# ---- group: Triangulate and Repair
tri = Triangulate(Mesh=wbloop)  # -> Mesh, Count
wbjoin = WeaverbirdsJoinMeshesAndWeld(Mesh=tri.Mesh, Weld=True)
cullvertices = MeshCullUnusedVertices(Mesh=wbjoin)
# Prepare for Karamba
# Meshes in Karamba are triangulated and vertices are welded within a certain distance (LDist). This needs to be done first to ensure the correct appointment of vertices as loads and supports.
clean = CombineClean(Meshes=cullvertices)

# ---- group: Prepare for Karamba
demesh = DeconstructMesh(Mesh=clean)  # -> Vertices, Faces, Colours, Normals
rdpoints = RemoveDuplicatePointsKaramba3D(Point=demesh.Vertices, LimitDistance=0.005)  # -> OutPoint, Info, Indexes
deletev = DeleteVertices(Mesh=clean, Indices=rdpoints.Indexes, Shrink=True)
meshcap = MeshCap(Mesh=deletev)
wbjoin_2 = WeaverbirdsJoinMeshesAndWeld(Mesh=meshcap, Weld=True)

# ----
mesh = Mesh(wbjoin_2)

# ----
# Supports
pt = Point([Point(421.0269441, 112.5174102, 25.95941836), Point(424.7991223, 110.9657935, 24.17115463), Point(428.0318609, 109.1951316, 22.45943633), Point(427.1940407, 104.7936766, 20.234263), Point(424.7833339, 101.8395183, 19.42577038), Point(421.9921434, 102.9327556, 20.69588293)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])
demesh_2 = DeconstructMesh(Mesh=mesh)  # -> Vertices, Faces, Colours, Normals
duppt = RemoveDuplicatePts(Points=pt, Tolerance=0.01)
fsim = FindSimilarMember(Data=duppt, Set=demesh_2.Vertices)  # -> Hit, Index
pl = PlaneNormal(Origin=demesh_2.Vertices, ZAxis=demesh_2.Normals)
item = ListItem(List=pl, Index=fsim.Index, Wrap=True)
supp = SupportKaramba3D(PosInd=fsim.Index, PlaneOfReference=item, menu=[buttons(on, on, on, on, on, on)])

# ----
# Prepare Karamba Model
# The mesh is analyzed as a shell. The properties of the shell are determined here. Since in this case we are not using exact values but implicit color data, the height of the shell can be used to control the spread of the forces.
# Loads and Supports
# Assign the loads and supports by indicating the concerning vertices. Use a 'find similar member' to find the indices and ensure the correct vertices are indicated.
# The provided load- and support cases are an estimation and therefore most likely not accurate. The actual situation would need to be determined together with a structural engineer. For this project it is relevant to learn how the information of the structural analysis can be used to inform a design. Succeeding in this will also show that it can be done with the support- and load cases provided by the structural engineer.
number_slider = Slider(15, range=0..100)
matselect = MaterialSelectionKaramba3D(menu=[dropdown(4), dropdown(1)])
cross_section = CrossSectionKaramba3D(FamilyNameOfCrossSection="DefaultCroSec", Material=matselect, Height_cm=number_slider, mode="Shell - Const")
meshtoshell = MeshToShellKaramba3D(Mesh=mesh, CrossSection=cross_section, LimitDistance_m=0.005)  # -> Element, Points, Info

# ---- group: Soil Pressure
neg = Negative(Value=demesh_2.Normals)
loads = LoadsKaramba3D(Vectors=neg, Mesh=mesh, LCase=0, mode="MeshLoad -Variable", menu=[buttons(on, off, off), buttons(on, on)])

# ---- group: Gravity
loads_2 = LoadsKaramba3D(Vector=Vector(0, 0, -1), LCase=0, mode="Gravity")

# ----
# Loads
merge = Merge(Data1=loads_2, Data2=loads)  # -> flatten(Result)

# ----
# Analysis
assemble = AssembleModelKaramba(Elem=meshtoshell.Element, Support=supp, Load=merge, LimitDistance_m=0.005)  # -> Model, Info, Mass_kg, CenterOfGravity
analyze = AnalyzeKaramba3D(Model=assemble.Model)  # -> CalculatedModel, MaximumDisplacement_cm, ResultingForceOfGravity_kN, ElasticEnergy_kNm

# ---- group: Stress Lines
number_slider_2 = Slider(3, range=0..3)  # disabled
onoff = EnableDisableObject(
    Enabled=Toggle(False),
    AllObjects_Object=[shelllineresults, number_slider_3, rdpoints_2, number_slider_2, join, join_2, preview_2, swatch, preview, swatch_2])
number_slider_3 = Slider(5, range=0..100)  # disabled
rdpoints_2 = RemoveDuplicatePointsKaramba(Point=meshtoshell.Points, LDist=number_slider_2)  # -> OutPoint, Info, Indexes; disabled
shelllineresults = LineResultsOnShellsKaramba3D(
    AnalyzedModel=analyze.CalculatedModel,
    LayerPosition=0,
    ListOfSourcesOfPrincipalStressLinesLinesPoints=rdpoints_2.OutPoint,
    SegmentLength_m=0.5,
    DA_deg=number_slider_3,
    mode="PrincStress")  # -> AnalyzedModel, Lines1, Lines2; disabled
swatch = ColourSwatch(SwatchColor=RGB(0, 8, 255))  # disabled
swatch_2 = ColourSwatch(SwatchColor=RGB(255, 0, 0))  # disabled
join = JoinCurves(Curves=shelllineresults.Lines1, Preserve=False)  # disabled
join_2 = JoinCurves(Curves=shelllineresults.Lines2, Preserve=False)  # disabled
preview = CustomPreview(Geometry=join_2, Material=swatch_2)  # disabled
preview_2 = CustomPreview(Geometry=join, Material=swatch)  # disabled

# ----
# Visualization
# Different types of structural data can be analyze and visualized. In this project we aim to increase voronoi cell density in structurally relevant areas and vice versa. To do so the utilization data is used.
modelview = ModelViewKaramba3D(Model=analyze.CalculatedModel, LoadCaseFactorsForLinearSuperposition=1, IndexOfVisibleLoadcase=-1)  # -> Model, DeformedMesh, DeformedAxes, DeformedModel
shellview = ShellViewKaramba3D(Model=modelview.Model, IndexOfLayer=0)  # -> Model, MeshesOfRenderedShells, LegendColors, LegendTags
legend = Legend(Colour=shellview.LegendColors, Tags=shellview.LegendTags, LegendType=1)
item_2 = ListItem(List=shellview.MeshesOfRenderedShells, Index=Slider(1, range=0..1), Wrap=True)

# ---- group: Stress Field
onoff_2 = EnableDisableObject(Enabled=Toggle(False), AllObjects_Object=[vdisex_2, vdisex, shellvecresults, amp, amp_2, number_slider_4])
shellvecresults = ResultVectorsOnShellsKaramba3D(AnalyzedModel=modelview.Model, LayerPosition=0, mode="PrincStress")  # -> AnalyzedModel, Points, FirstPrincipalStressVector_kN_cm2, SecondPrincipalStressVector_kN_cm2, FirstPrincipalStressValue_kN_cm2, SecondPrincipalStressValue_kN_cm2; disabled
number_slider_4 = Slider(1, range=0..10)  # disabled
amp = Amplitude(Vector=shellvecresults.FirstPrincipalStressVector_kN_cm2, Amplitude=shellvecresults.FirstPrincipalStressValue_kN_cm2)  # disabled
amp_2 = Amplitude(Vector=shellvecresults.SecondPrincipalStressVector_kN_cm2, Amplitude=shellvecresults.SecondPrincipalStressValue_kN_cm2)  # disabled
vdisex = VectorDisplayEx(Point=shellvecresults.Points, Vector=amp_2, Colour=swatch_2, Width=number_slider_4)  # disabled
vdisex_2 = VectorDisplayEx(Point=shellvecresults.Points, Vector=amp, Colour=swatch, Width=number_slider_4)  # disabled

# ---- group: Bake
button = Button()

# ----
# Bake
# Bake the geometry to a specific layer. Use the layer name attribute to define the layer and use this in the geometry pipeline in a succeeding script. Use the bakename to replace any geometry previously bake with that name.
panel = Panel("SA::Utilization")
attributes = DefineObjectAttributes(Layer=panel)
bake = BakeObjects(Geometry=item_2, Attributes=attributes, BakeName="Utilization Mesh", Bake=button)
