# Grasshopper definition Voronoi Structure.gh (Grasshopper 1.0.7)
# plug-ins: Anemone, Pufferfish, Human, MetaHopper, MeshEdit Components, Kangaroo Components, Weaverbird, EleFront

# ----
# Voronoi Structure
# In this tutorial a voronoi structure will be generated from a (collection of) informed point cloud(s). A skin will be created by pro- or extruding the outer cells. This is done taking into consideration certain requirements concerning printability.
# Halfway the script a toggle turns off a part of the script to reduce the computation time when opening it. Set the toggle to true to generate the voronoi structure.
# Refer to Geometry
pipeline = GeometryPipeline(
    GroupByLayer=False,
    GroupByType=False,
    IncludeHidden=True,
    IncludeLocked=True,
    LayerFilter="Fragment::Volume::Surroundings_Reduced",
    NameFilter="*",
    SublayerFiltering=True,
    TypeFilter=33)
pipeline_2 = GeometryPipeline(
    GroupByLayer=False,
    GroupByType=False,
    IncludeHidden=True,
    IncludeLocked=True,
    LayerFilter="Fragment::Volume::Fragment",
    NameFilter="*",
    SublayerFiltering=True,
    TypeFilter=33)
pipeline_3 = GeometryPipeline(
    GroupByLayer=False,
    GroupByType=False,
    IncludeHidden=True,
    IncludeLocked=True,
    LayerFilter="Fragment::Point Clouds::SA",
    NameFilter="*",
    SublayerFiltering=True,
    TypeFilter=1)
pipeline_4 = GeometryPipeline(
    GroupByLayer=False,
    GroupByType=False,
    IncludeHidden=True,
    IncludeLocked=True,
    LayerFilter="Main Volume",
    NameFilter="*",
    SublayerFiltering=True,
    TypeFilter=32)
pipeline_5 = GeometryPipeline(
    GroupByLayer=False,
    GroupByType=False,
    IncludeHidden=True,
    IncludeLocked=True,
    LayerFilter="Fragment::Skin",
    NameFilter="*",
    SublayerFiltering=True,
    TypeFilter=32)

volume = MeshVolume(Mesh=pipeline_2)  # -> Volume, Centroid

# ----
# Print- Plane and Direction
xy = XYPlane(Origin=volume.Centroid)
Z = UnitZ(Factor=1)

speed = Slider(15, range=0..20)
visualize = BooleanToggle(False)
onoff = EnableDisableObject(
    Enabled=visualize,
    AllObjects_Object=[len_2, sort, distances, previewlw_2, swatch, previewlw, swatch_2, prox_3, number_slider_3, cset_2, len, remap_3, dom_2, hsv])
Z_2 = UnitZ(Factor=1)  # disabled

# ----
# Gradient and Distance
# Because the point clouds have been generated individually they need to be edited as a whole. The point density determines the cell sizes and these need to be adjusted to the printer properties. In this case we know from experiments with the used printer that the cell sizes need to be at least 60 mm in diameter. Therefore this is also the minimum distance between points. Besides the distance, a smoother transition between the densities is created here.
number_slider = Slider(1200, range=0..1200)
loop_start = LoopStart(Repeat=number_slider, Trigger=Button(), Data=pipeline_3)  # -> port, Counter, Data
pt = Point(loop_start.Data)
panel = Panel(loop_start.Counter)

# ----
# The vectors from points within a certain distance from the main point are calculated and their length remapped according to the desired distances. Ultimately the vectors are averaged.
# Distance
number_slider_2 = Slider(150, range=0..1000)
minimum_distance = Slider(60, range=0..100)
prox = Proximity3D(Points=pt, Group=Slider(10, range=0..10), MaxRadius=number_slider_2)  # -> Links, Topology
item = ListItem(List=pt, Index=prox.Topology, Wrap=True)
vec2pt = Vector2Pt(PointA=graft(pt), PointB=item, Unitize=False)  # -> expr("-x", Vector), Length
dom = ConstructDomain(DomainStart=minimum_distance, DomainEnd=number_slider_2)
remap = RemapNumbers(Value=vec2pt.Length, Source=dom, Target=Domain(1, 0))  # -> Mapped, Clipped
graph = GraphMapper(remap.Clipped, x0=0, x1=1, y0=0, y1=1, container_name="Bezier", cpx=[0, 0.5686368346, 0.829112649, 1], cpy=[0, 0, 1, 1])
vec = VectorXYZ(XComponent=0, YComponent=0, ZComponent=0)  # -> Vector, Length

multiplication = Multiplication(A=graph, B=speed)

amp = Amplitude(Vector=vec2pt.Vector, Amplitude=multiplication)
avr = Average(Input=amp)
# The loop is now focused on increasing the distance of points within a certain distance and exits accordingly. When the exit loop properties are adjusted, the 'Maximum Radius' slider and the relating graph mapper can be used to create smoother transitions between densities.
nullrep = ReplaceNulls(Items=avr, Replacements=vec.Vector)  # -> Items, Count

# ----
# Parallel to Skin
# The distance vectors are projected to be parallel to the nearest point of the skin.
mesh = Mesh(pipeline)
meshcp = MeshClosestPoint(Point=pt, Mesh=mesh)  # -> Point, Index, Parameter
meval = MeshEval(Mesh=mesh, Parameter=meshcp.Parameter)  # -> Point, Normal, Colour
pl = PlaneNormal(Origin=Point(0, 0, 0), ZAxis=meval.Normal)
project = Project(Geometry=nullrep.Items, Plane=graft(pl))  # -> Geometry, Transform
vlen = VectorLength(Vector=nullrep.Items)
amp_2 = Amplitude(Vector=project.Geometry, Amplitude=vlen)

# ----
# Surface Proximity
# The closer to the skin, the more the vector should be parallel to it. The distance to the skin is remapped to a value of 0-1 so it can be used as a tweening factor.
dist = Distance(PointA=pt, PointB=meshcp.Point)  # -> graft(Distance)
remap_2 = RemapNumbers(Value=dist, Source=Domain(30, 300), Target=Domain(1, 0))  # -> Mapped, Clipped

twn2vecs = TweenTwoVectors(VectorA=nullrep.Items, VectorB=amp_2, Factor=remap_2.Clipped)
move = Move(Geometry=graft(pt), Motion=twn2vecs)  # -> flatten(Geometry), Transform

# ----
# Exit Loop
# The loop can be exited when all distances between points exceed the minimum (60mm).
minimum_smoothing_steps = Slider(10, range=0..10)
prox_2 = Proximity3D(Points=move.Geometry, Group=5, MaxRadius=minimum_distance)  # -> flatten(Links), Topology
lng = ListLength(List=prox_2.Links)
cset = CreateSet(List=flatten(prox_2.Topology))  # -> Set, Map
equals = Equality(FirstNumber=lng, SecondNumber=0)  # -> Equality, Inequality
lng_2 = ListLength(List=cset.Set)  # -> expr("x/2", Length)
larger = LargerThan(FirstNumber=loop_start.Counter, SecondNumber=minimum_smoothing_steps)  # -> LargerThan, OrEqualTo
points_within_distance = Panel(lng_2)
and = GateAnd(A=equals.Equality, B=larger.LargerThan)

len = Length(Curve=prox_2.Links)  # disabled
dom_2 = ConstructDomain(DomainStart=expr("x/2", minimum_distance), DomainEnd=minimum_distance)  # disabled
remap_3 = RemapNumbers(Value=len, Source=dom_2, Target=Domain(1, 0.5))  # -> Mapped, Clipped; disabled
hsv = ColourHSV(Alpha=1, Hue=0, Saturation=remap_3.Clipped, Value=1)  # disabled

loop_end = LoopEnd(port=loop_start.port, Exit=and, Data=move.Geometry, TimeOutVal=0, pausedState=False, state="Output last")

# ----
# Compare
list = ValueList({"Initial Point Cloud": 0, "Edited Point Cloud": 1}, selected="Initial Point Cloud")
filter = StreamFilter(Gate=list, Stream1=loop_end)

# ----
# Select Points
pt_2 = Point(loop_end)
mesh_2 = Mesh(pipeline_2)
minc = MeshInclusion(Mesh=mesh_2, Point=pt_2, Strict=False)
meshcp_2 = MeshClosestPoint(Point=pt_2, Mesh=mesh_2)  # -> Point, Index, Parameter
dist_2 = Distance(PointA=pt_2, PointB=meshcp_2.Point)
smaller = SmallerThan(FirstNumber=dist_2, SecondNumber=Slider(200, range=0..1000))  # -> SmallerThan, OrEqualTo
or = GateOr(A=minc, B=smaller.SmallerThan)
cull = CullPattern(List=pt_2, CullPattern=or)

# ----
# Visualize
prox_3 = Proximity3D(Points=move.Geometry, Group=9, MaxRadius=number_slider_2)  # -> flatten(Links), Topology; disabled
number_slider_3 = Slider(3, range=0..10)  # disabled
len_2 = Length(Curve=prox_2.Links)  # disabled
swatch = ColourSwatch(SwatchColor=RGB(153, 72, 72))  # disabled
sort = SortList(Keys=len_2)  # -> Keys, ValuesA; disabled
swatch_2 = ColourSwatch(SwatchColor=RGBA(128, 128, 128, 150))  # disabled
previewlw = CustomPreviewLineweights(Geometry=prox_3.Links, Shader=swatch_2, Absolute=False)  # disabled
previewlw_2 = CustomPreviewLineweights(Geometry=prox_2.Links, Shader=hsv, Thickness=number_slider_3, Absolute=False)  # disabled

cset_2 = CreateSet(List=sort.Keys)  # -> Set, Map; disabled

distances = Panel(cset_2.Set)  # disabled

# ---- group: Voronoi Mesh
number_slider_4 = Slider(2.5, range=1..3)  # disabled
scale_nu = ScaleNU(Geometry=cull, Plane=xy, ScaleX=1, ScaleY=1, ScaleZ=expr("1/x", number_slider_4))  # -> Geometry, Transform; disabled
bbox = BoundingBox(Content=scale_nu.Geometry, Plane=PlaneXY(0, 0, 0), UnionBox=True)  # -> Box, Box_2; disabled

# ----
volume_2 = Volume(Geometry=bbox.Box)  # -> Volume, Centroid; disabled
scale = Scale(Geometry=bbox.Box, Center=volume_2.Centroid, Factor=1.5)  # -> Geometry, Transform; disabled

# ---- group: Voronoi Mesh (continued)
_3dvoro = _3DVoronoi(Points=scale_nu.Geometry, Boundingbox=scale.Geometry)  # -> _3DVoronoiCells, Connectivity; disabled
scale_nu_2 = ScaleNU(Geometry=_3dvoro._3DVoronoiCells, Plane=xy, ScaleX=1, ScaleY=1, ScaleZ=number_slider_4)  # -> Geometry, Transform; disabled
pline2msh = PolylineToMesh(Polyline=scale_nu_2.Geometry, Quadrangulate=False)  # disabled

# ---- group: Geometry Cut
mesh_3 = Mesh(pipeline_2)  # disabled
msplit = MeshSplit(Mesh=pline2msh, Splitters=mesh_3)  # -> graft(Result); disabled
offmsh = OffsetMesh(Mesh=mesh_3, Distance=1, BothSides=False, CreateSolid=False)  # disabled
demesh = DeconstructMesh(Mesh=msplit)  # -> Vertices, Faces, Colours, Normals; disabled
minc_2 = MeshInclusion(Mesh=offmsh, Point=demesh.Vertices, Strict=False)  # disabled
ma = MassAddition(Input=minc_2)  # -> Result, PartialResults; disabled
lng_3 = ListLength(List=minc_2)  # disabled
equals_2 = Equality(FirstNumber=ma.Result, SecondNumber=lng_3)  # -> Equality, Inequality; disabled
cull_2 = CullPattern(List=msplit, CullPattern=equals_2.Equality)  # disabled
trim = TrimTree(Tree=simplify(cull_2), Depth=2)  # disabled

# ---- group: Repair
clean = CombineClean(Meshes=graft(trim))  # disabled
weldvertices = MeshWeldVertices(Mesh=clean, Tolerance=0.1)  # -> RuntimeMessage, Mesh; disabled
cullvertices = MeshCullUnusedVertices(Mesh=weldvertices.Mesh)  # disabled
unim = UnifyMesh(Mesh=cullvertices)  # -> Result, Count; disabled
trim_2 = TrimTree(Tree=simplify(unim.Result), Depth=1)  # disabled

# ----
# Voronoi Generation
# The voronoi strucutre is generated here. Because this can be computationally heavy, the toggle needs be be switched in order to enable the components.
# The voronoi pattern is stretched in the printing direction. In this way most of the cell faces gain a printable orientation. To ensure the informed densities remain accurate, the point cloud is first compressed by the stretching factor.
# The stretching is used to generated faces in a certain orientation relating to printability. In general, the more it is stretched the more faces are printable. Notice how this parameter affects the overall aesthetics.
toggle = BooleanToggle(False)
onoff_2 = EnableDisableObject(Enabled=toggle, AllObjects_Object=[_3dvoro, pline2msh, msplit, demesh, minc_2, cull_2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])
mesh_4 = Mesh(trim_2)  # disabled
clean_2 = CleanTree(RemoveNulls=True, RemoveInvalid=True, RemoveEmpty=False, Tree=mesh_4)  # disabled

# ----
# Select Skin Cells
# Select the cells facing the interior. The open parts of these cells will be used to create a skin pattern.
wbjoin = WeaverbirdsJoinMeshesAndWeld(Mesh=simplify(clean_2), Weld=True)  # disabled
wbnaked = WeaverbirdsNakedBoundary(MeshClosedPolylines=wbjoin)  # disabled
explode = Explode(Curve=wbnaked, Recursive=True)  # -> Segments, Vertices; disabled
number_slider_5 = Slider(10, range=0..10)  # disabled
meshcp_3 = MeshClosestPoint(Point=explode.Vertices, Mesh=pipeline_5)  # -> Point, Index, Parameter; disabled
dist_3 = Distance(PointA=explode.Vertices, PointB=meshcp_3.Point)  # disabled
smaller_2 = SmallerThan(FirstNumber=dist_3, SecondNumber=number_slider_5)  # -> SmallerThan, OrEqualTo; disabled
cull_3 = CullPattern(List=explode.Vertices, CullPattern=smaller_2.SmallerThan)  # disabled
pline = PolyLine(Vertices=cull_3, Closed=True)  # -> flatten(Polyline); disabled
clean_3 = CleanTree(RemoveNulls=True, RemoveInvalid=True, RemoveEmpty=False, Tree=pline)  # -> graft(Tree); disabled

# ---- group: Angle
mesh_5 = Mesh(clean_2)  # disabled
wbnaked_2 = WeaverbirdsNakedBoundary(MeshClosedPolylines=mesh_5)  # disabled
vec_2 = Vector(expr("-x", Z_2))  # disabled
planar = Planar(Curve=wbnaked_2)  # -> Planar, Plane, Deviation; disabled
vec_3 = Vector(Z_2)  # disabled
merge = Merge(Data1=vec_3, Data2=vec_2)  # disabled
deplane = DeconstructPlane(Plane=planar.Plane)  # -> Origin, XAxis, YAxis, ZAxis; disabled
cvec = ClosestVector(Reference=deplane.ZAxis, Targets=merge, KeepLength=False)  # -> Closest, Index, Angle; disabled
pi = Pi(Factor=0.25)  # disabled
larger_2 = LargerThan(FirstNumber=cvec.Angle, SecondNumber=pi)  # -> LargerThan, OrEqualTo; disabled

# ----
# 45 Degree Rule
# Faces can be printed when the angle with the print bed is more than 45 degrees. Most faces meet this requirement after stretching, the others are culled here.
cull_4 = CullPattern(List=mesh_5, CullPattern=larger_2.LargerThan)  # disabled

# ---- group: Percentage of remaining Faces
lng_4 = ListLength(List=flatten(cull_4))  # disabled
lng_5 = ListLength(List=flatten(larger_2.LargerThan))  # disabled
division = Division(A=lng_4, B=lng_5)  # disabled
percentage_kept = Panel(division)  # disabled

# ---- group: Cull Smallest Area
number_slider_6 = Slider(150, range=0..1000)  # disabled
crv = Curve(clean_3)  # disabled
len_3 = Length(Curve=crv)  # disabled
smaller_3 = SmallerThan(FirstNumber=len_3, SecondNumber=number_slider_6)  # -> SmallerThan, OrEqualTo; disabled
# Edges and Fill
# The smallest areas are seperated and filled. The others are scaled to generate a small offset.
dispatch = Dispatch(List=crv, DispatchPattern=smaller_3.SmallerThan)  # -> ListA, ListB; disabled

# ---- group: Scale
number_slider_7 = Slider(0.904, range=0..1)  # disabled
pcen = PolygonCenter(Polyline=crv)  # -> CenterV, CenterE, CenterA; disabled
scale_2 = Scale(Geometry=dispatch.ListB, Center=pcen.CenterV, Factor=number_slider_7)  # -> Geometry, Transform; disabled

# ---- group: Mesh
explode_2 = Explode(Curve=scale_2.Geometry, Recursive=True)  # -> Segments, Vertices; disabled
explode_3 = Explode(Curve=dispatch.ListB, Recursive=True)  # -> Segments, Vertices; disabled
rulesrf = RuledSurface(CurveA=explode_3.Segments, CurveB=explode_2.Segments)  # disabled
smesh = SimpleMesh(Brep=rulesrf)  # disabled
wbjoin_2 = WeaverbirdsJoinMeshesAndWeld(Mesh=smesh, Weld=True)  # disabled
pline2msh_2 = PolylineToMesh(Polyline=dispatch.ListA, Quadrangulate=True)  # disabled

# ----
# Skin Pattern
# The skin cells are scaled and ex-/protruded according to proximity of geometry in Rhino. This provides manual control of the scaling- and pro-/extruding values. The pro-/extrusion values are clipped by maximums to prevent intersections with the interior cells and ensure the faces' orientations remain more than 45 degrees from the print direction. The intersection prevention is calculated by projecting the points of the initial scaled polylines to the interior cells. The smallest distance is the maximum possible protrusion. The maximum values solving the 45 degree requirements are calculated by a combination of the angle between the print direction and pro-/extrusion direction and the smallest distance between the inital- and scaled polylines.
# In this case the angle between print- and normal vector exceeds π/4 which means the matter can be approached in a certain way. If this is not the case the issue becomes a bit more complex. For this check the respective file at:  http://uf.roboticbuilding.eu/index.php/W4:Online
crv_2 = Curve(scale_2.Geometry)  # disabled
pt_3 = Point(pcen.CenterV)  # disabled
mesh_6 = Mesh(pipeline_5)  # disabled
meshcp_4 = MeshClosestPoint(Point=pt_3, Mesh=mesh_6)  # -> Point, Index, Parameter; disabled
meval_2 = MeshEval(Mesh=mesh_6, Parameter=meshcp_4.Parameter)  # -> Point, Normal, Colour; disabled

# ----
# Scale
pipeline_6 = GeometryPipeline(
    GroupByLayer=False,
    GroupByType=False,
    IncludeHidden=True,
    IncludeLocked=True,
    LayerFilter="Fragment::GH Input::Skin::Scale",
    NameFilter="*",
    SublayerFiltering=True,
    TypeFilter=4)  # disabled
number_slider_8 = Slider(750, range=0..1000)  # disabled
number_slider_9 = Slider(1100, range=0..1100)  # disabled
pull = PullPoint(Point=pt_3, Geometry=pipeline_6, ClosestOnly=True)  # -> ClosestPoint, Distance; disabled
number_slider_10 = Slider(0.15, range=0..1)  # disabled
number_slider_11 = Slider(0.6, range=0..1)  # disabled
dom_3 = ConstructDomain(DomainStart=number_slider_8, DomainEnd=number_slider_9)  # disabled
remap_4 = RemapNumbers(Value=pull.Distance, Source=dom_3, Target=Domain(0, 1))  # -> Mapped, Clipped; disabled
graph_2 = GraphMapper(
    remap_4.Clipped,
    x0=0,
    x1=1,
    y0=0,
    y1=1,
    container_name="Bezier",
    cpx=[0, 0.9194669127, 0.3829900622, 1],
    cpy=[0, 0, 1, 1])  # disabled
dom_4 = ConstructDomain(DomainStart=number_slider_11, DomainEnd=number_slider_10)  # disabled
remap_5 = RemapNumbers(Value=graph_2, Source=Domain(0, 1), Target=dom_4)  # -> Mapped, Clipped; disabled
scale_3 = Scale(Geometry=crv_2, Center=pt_3, Factor=remap_5.Clipped)  # -> Geometry, Transform; disabled

# ---- group: Extrusion Value
pipeline_7 = GeometryPipeline(
    GroupByLayer=False,
    GroupByType=False,
    IncludeHidden=True,
    IncludeLocked=True,
    LayerFilter="Fragment::GH Input::Skin::Extrude",
    NameFilter="*",
    SublayerFiltering=True,
    TypeFilter=4)  # disabled
number_slider_12 = Slider(900, range=0..1000)  # disabled
number_slider_13 = Slider(1100, range=0..1100)  # disabled
pull_2 = PullPoint(Point=pt_3, Geometry=pipeline_7, ClosestOnly=True)  # -> ClosestPoint, Distance; disabled
number_slider_14 = Slider(130, range=0..1000)  # disabled
number_slider_15 = Slider(30, range=0..100)  # disabled
dom_5 = ConstructDomain(DomainStart=number_slider_12, DomainEnd=number_slider_13)  # disabled
remap_6 = RemapNumbers(Value=pull_2.Distance, Source=dom_5, Target=Domain(0, 1))  # -> Mapped, Clipped; disabled
graph_3 = GraphMapper(
    remap_6.Clipped,
    x0=0,
    x1=1,
    y0=0,
    y1=1,
    container_name="Bezier",
    cpx=[0, 0.4724343121, 0.7348299623, 1],
    cpy=[0, 0, 1, 1])  # disabled
dom_6 = ConstructDomain(DomainStart=number_slider_14, DomainEnd=number_slider_15)  # disabled
remap_7 = RemapNumbers(Value=graph_3, Source=Domain(0, 1), Target=dom_6)  # -> Mapped, Clipped; disabled

# ----
# Keep within 45 Degrees
vec_4 = Vector(Z)  # disabled
neg = Negative(Value=vec_4)  # disabled
cvec_2 = ClosestVector(Reference=meval_2.Normal, Targets=[vec_4, neg], KeepLength=False)  # -> Closest, Index, Angle; disabled
explode_4 = Explode(Curve=scale_3.Geometry, Recursive=True)  # -> Segments, Vertices; disabled
graph_4 = GraphMapper(cvec_2.Angle, x0=0, x1=1.5707, y0=0, y1=1, container_name="Sine", Equation_px=[0, 0.5004993677], Equation_py=[1, 0])  # disabled
crv_cp = CurveClosestPoint(Point=explode_4.Vertices, Curve=crv_2)  # -> Point, Parameter, Distance; disabled
sort_2 = SortList(Keys=crv_cp.Distance)  # -> Keys, ValuesA; disabled
item_2 = ListItem(List=sort_2.Keys, Index=0, Wrap=True)  # disabled
nullrep_2 = ReplaceNulls(Items=item_2, Replacements=number_slider_14)  # -> Items, Count; disabled
multiplication_2 = Multiplication(A=nullrep_2.Items, B=graph_4)  # disabled
dom_7 = ConstructDomain(DomainStart=0, DomainEnd=expr("x-1", multiplication_2))  # disabled

# ---- group: Protrusion Value
pipeline_8 = GeometryPipeline(
    GroupByLayer=False,
    GroupByType=False,
    IncludeHidden=True,
    IncludeLocked=True,
    LayerFilter="Fragment::GH Input::Skin::Protrude",
    NameFilter="*",
    SublayerFiltering=True,
    TypeFilter=4)  # disabled
number_slider_16 = Slider(500, range=0..1000)  # disabled
number_slider_17 = Slider(600, range=0..1000)  # disabled
pull_3 = PullPoint(Point=pt_3, Geometry=pipeline_8, ClosestOnly=True)  # -> ClosestPoint, Distance; disabled
number_slider_18 = Slider(200, range=0..1000)  # disabled
number_slider_19 = Slider(40, range=0..100)  # disabled
dom_8 = ConstructDomain(DomainStart=number_slider_16, DomainEnd=number_slider_17)  # disabled
remap_8 = RemapNumbers(Value=pull_3.Distance, Source=dom_8, Target=Domain(0, 1))  # -> Mapped, Clipped; disabled
graph_5 = GraphMapper(
    remap_8.Clipped,
    x0=0,
    x1=1,
    y0=0,
    y1=1,
    container_name="Bezier",
    cpx=[0, 0.4724343121, 0.7348299623, 1],
    cpy=[0, 0, 1, 1])  # disabled
dom_9 = ConstructDomain(DomainStart=number_slider_18, DomainEnd=number_slider_19)  # disabled
remap_9 = RemapNumbers(Value=graph_5, Source=Domain(0, 1), Target=dom_9)  # -> Mapped, Clipped; disabled

# ---- group: Prevent Intersection
mjoin = MeshJoin(Meshes=flatten(wbjoin))  # disabled
explode_5 = Explode(Curve=scale_3.Geometry, Recursive=True)  # -> Segments, Vertices; disabled
project_2 = ProjectPoint(Point=explode_5.Vertices, Direction=expr("-x", meval_2.Normal), Geometry=mjoin)  # -> Point, Index; disabled
dist_4 = Distance(PointA=explode_5.Vertices, PointB=project_2.Point)  # disabled
sort_3 = SortList(Keys=dist_4)  # -> Keys, ValuesA; disabled
item_3 = ListItem(List=sort_3.Keys, Index=0, Wrap=True)  # -> simplify(Item); disabled
dom_10 = ConstructDomain(DomainStart=0, DomainEnd=item_3)  # disabled
remap_10 = RemapNumbers(Value=remap_9.Clipped, Source=dom_10, Target=dom_10)  # -> Mapped, Clipped; disabled

# ----
# The geometry from which the proximity is calculated is manually drawn in Rhino (in the sublayers of "GH Input"). It can of course also be generated geometry, or the values can be originating from a different source, for example similar to the colored data in the structural analysis. In this way these tools can be used to create an informed design.
# Think for example of the location of a seating area, the use of solar (or lighting in the case of an underground base on Mars) analysis or acoustic optimization as a source for the scaling- and pro-/extrusion values.
# For tutorials concerning these kind of analysis see: http://cs.roboticbuilding.eu/index.php/2019W2:Page4.
# Extrusion
remap_11 = RemapNumbers(Value=remap_7.Clipped, Source=dom_7, Target=dom_7)  # -> Mapped, Clipped; disabled
amp_3 = Amplitude(Vector=meval_2.Normal, Amplitude=remap_11.Clipped)  # disabled

# ----
# Protrusion
remap_12 = RemapNumbers(Value=remap_10.Clipped, Source=dom_7, Target=dom_7)  # -> Mapped, Clipped; disabled
amp_4 = Amplitude(Vector=expr("-x", meval_2.Normal), Amplitude=remap_12.Clipped)  # disabled

# ----
# Select Vectors
larger_3 = LargerThan(FirstNumber=pull_2.Distance, SecondNumber=pull_3.Distance)  # -> LargerThan, OrEqualTo; disabled
weave = Weave(Pattern=larger_3.LargerThan, Stream0=amp_3, Stream1=amp_4, NullGaps=False)  # disabled

# ----
# Create Meshes
move_2 = Move(Geometry=scale_3.Geometry, Motion=weave)  # -> Geometry, Transform; disabled
explode_6 = Explode(Curve=move_2.Geometry, Recursive=True)  # -> Segments, Vertices; disabled
explode_7 = Explode(Curve=crv_2, Recursive=True)  # -> Segments, Vertices; disabled
rulesrf_2 = RuledSurface(CurveA=explode_7.Segments, CurveB=explode_6.Segments)  # disabled
smesh_2 = SimpleMesh(Brep=rulesrf_2)  # disabled
wbjoin_3 = WeaverbirdsJoinMeshesAndWeld(Mesh=smesh_2, Weld=True)  # disabled

# ----
# Fill
pipeline_9 = GeometryPipeline(
    GroupByLayer=False,
    GroupByType=False,
    IncludeHidden=True,
    IncludeLocked=True,
    LayerFilter="Fragment::GH Input::Skin::Fill",
    NameFilter="*",
    SublayerFiltering=True,
    TypeFilter=4)  # disabled
number_slider_20 = Slider(900, range=0..1000)  # disabled
pull_4 = PullPoint(Point=pt_3, Geometry=pipeline_9, ClosestOnly=True)  # -> ClosestPoint, Distance; disabled
larger_4 = LargerThan(FirstNumber=pull_4.Distance, SecondNumber=number_slider_20)  # -> LargerThan, OrEqualTo; disabled
pline2msh_3 = PolylineToMesh(Polyline=move_2.Geometry, Quadrangulate=True)  # disabled
number_slider_21 = Slider(0, range=0..1)  # disabled
cull_5 = CullPattern(List=pline2msh_3, CullPattern=larger_4.LargerThan)  # disabled
filter_2 = StreamFilter(Gate=number_slider_21, Stream0=cull_5, Stream1=pline2msh_3)  # disabled

merge_2 = Merge(Data1=simplify(pline2msh_2), Data2=simplify(wbjoin_2), Data3=simplify(wbjoin_3), Data4=simplify(filter_2))  # disabled

# ----
# Replace Paths
# To join the respective meshes correctly they need to be in the same tree path. Therefore the paths of the original data tree are reapplied here.
lng_6 = ListLength(List=wbnaked)
mindex = MemberIndex(Set=lng_6, Member=0)  # -> Index, Count
replace = ReplaceItems(List=lng_6, Item=1, Indices=mindex.Index, Wrap=False)
tstat = TreeStatistics(Tree=clean_2)  # -> Paths, Length, Count
dup = DuplicateData(Data=graft(tstat.Paths), Number=replace, Order=True)  # -> flatten(Data)
null = NullItem(Item=pline)  # -> NullFlags, InvalidFlags, Description
cull_6 = CullPattern(List=dup, CullPattern=invert(flatten(null.InvalidFlags)))
tstat_2 = TreeStatistics(Tree=merge_2)  # -> Paths, Length, Count
replace_2 = ReplacePaths(Data=merge_2, Search=tstat_2.Paths, Replace=cull_6)

# ---- group: Complete
merge_3 = Merge(Data1=simplify(replace_2), Data2=simplify(cull_4))
wbjoin_4 = WeaverbirdsJoinMeshesAndWeld(Mesh=merge_3, Weld=True)
bake = Button()
unim_2 = UnifyMesh(Mesh=wbjoin_4)  # -> Result, Count
attributes = DefineObjectAttributes(Layer="Fragment::Voronoi Structure::Cells")
bake_2 = BakeObjects(Geometry=unim_2.Result, Attributes=attributes, BakeName="Complete Cells", Bake=bake)

# ----
# Bake
# Bake the geometry to a specific layer. Use the layer name attribute to define the layer and use this in the geometry pipeline in a succeeding script. Use the bakename to replace any geometry previously bake with that name.
wbjoin_5 = WeaverbirdsJoinMeshesAndWeld(Mesh=merge_2, Weld=True)  # disabled
wbjoin_6 = WeaverbirdsJoinMeshesAndWeld(Mesh=cull_4, Weld=True)  # disabled
bake_3 = Button()  # disabled
panel_2 = Panel("Fragment::Voronoi Structure::Skin Cells")  # disabled
panel_3 = Panel("Fragment::Voronoi Structure::Interior Cells")  # disabled
unim_3 = UnifyMesh(Mesh=wbjoin_5)  # -> Result, Count; disabled
unim_4 = UnifyMesh(Mesh=wbjoin_6)  # -> Result, Count; disabled
panel_4 = Panel("Interior Cells")  # disabled
panel_5 = Panel("Skin Cells")  # disabled
attributes_2 = DefineObjectAttributes(Layer=panel_2)  # disabled
attributes_3 = DefineObjectAttributes(Layer=panel_3)  # disabled
bake_4 = BakeObjects(Geometry=unim_3.Result, Attributes=attributes_2, BakeName=panel_5, Bake=bake_3)  # disabled
bake_5 = BakeObjects(Geometry=unim_4.Result, Attributes=attributes_3, BakeName=panel_4, Bake=bake_3)  # disabled

# ----
# Visualize 45 Degree
# Provide color to the faces which exceed the 45 degree angle, to double check it.
clean_4 = CleanTree(RemoveNulls=True, RemoveInvalid=True, RemoveEmpty=True, Tree=flatten(merge_2))  # disabled
demesh_2 = DeconstructMesh(Mesh=clean_4)  # -> Vertices, Faces, Colours, Normals; disabled

# ---- group: Color data
vec_5 = Vector(Z)  # disabled
neg_2 = Negative(Value=vec_5)  # disabled
cvec_3 = ClosestVector(Reference=demesh_2.Normals, Targets=[vec_5, neg_2], KeepLength=False)  # -> Closest, Index, Angle; disabled
remap_13 = RemapNumbers(Value=cvec_3.Angle, Source=Domain(0.785398, 0), Target=Domain(0, 1))  # -> Mapped, Clipped; disabled
hsv_2 = ColourHSV(Alpha=1, Hue=0, Saturation=remap_13.Clipped, Value=1)  # disabled

# ----
conmesh = ConstructMesh(Vertices=demesh_2.Vertices, Faces=demesh_2.Faces, Colours=hsv_2)  # disabled

# ----
# Visualize
visualize_2 = BooleanToggle(False)  # disabled
thickness_thick = Slider(3.517, range=0..10)  # disabled
thickness_thin = Slider(1.145, range=0..10)  # disabled
onoff_3 = EnableDisableObject(Enabled=visualize_2, AllObjects_Object=wbnaked_3)  # disabled
curves_swatch = ColourSwatch(SwatchColor=RGB(41, 41, 41))  # disabled
curves_swatch_2 = ColourSwatch(SwatchColor=RGB(255, 0, 0))  # disabled
faces_swatch = ColourSwatch(SwatchColor=RGB(209, 209, 209))  # disabled
hideshow = HideShowObjectPreview(Visible=visualize_2, AllObjects_Object=[previewlw_4, preview, previewlw_3, previewlw_5])  # disabled
mesh_7 = Mesh(cull_4)  # disabled
clean_5 = CleanTree(RemoveNulls=True, RemoveInvalid=True, RemoveEmpty=False, Tree=mesh_7)  # disabled
wbnaked_3 = WeaverbirdsNakedBoundary(MeshClosedPolylines=clean_5)  # disabled
wbnaked_4 = WeaverbirdsNakedBoundary(MeshClosedPolylines=clean_4)  # disabled
previewlw_3 = CustomPreviewLineweights(Geometry=crv, Shader=curves_swatch, Thickness=thickness_thick, Absolute=False)  # disabled
preview = CustomPreview(Geometry=conmesh, Material=faces_swatch)  # disabled
previewlw_4 = CustomPreviewLineweights(Geometry=wbnaked_3, Shader=curves_swatch, Thickness=thickness_thin, Absolute=False)  # disabled
previewlw_5 = CustomPreviewLineweights(Geometry=wbnaked_4, Shader=curves_swatch, Thickness=thickness_thin, Absolute=False)  # disabled
